# Grasshopper definition CurrentWIP.gh (Grasshopper 1.0.7)

geometry_pipeline = GeometryPipeline(
    GroupByLayer=False,
    GroupByType=False,
    IncludeHidden=True,
    IncludeLocked=True,
    LayerFilter="Default",
    NameFilter="*",
    SublayerFiltering=True,
    TypeFilter=1073741848)
panel = Panel("""corr
corr
corr
brrm""")
roomsolid = HBRoomFromSolid(geo=flatten(geometry_pipeline), name=panel, conditioned=True)  # -> out, rooms; plug-in component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
# https://stackoverflow.com/questions/773/how-do-i-use-itertools-groupby
hb_face_attributes = HBFaceAttributes({"Display Name": "display_name", "Simulation Name (Identifier)": "identifier", "Boundary Condition": "boundary_condition", "Has Parent": "has_parent", "Parent": "parent", "Area": "area", "Perimeter": "perimeter", "Face Type": "type", "Aperture Is Operable": "is_operable", "Door Is Glass": "is_glass"}, selected="Boundary Condition")
solveadj = HBSolveAdjacency(rooms=flatten(roomsolid.rooms), run=Toggle(True))  # -> out, adj_rooms; plug-in component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
# For multiple stories:
# 
# from ittertools import groupby
# 
# for room in _model:
#      groupby(room.story)
# 
# groups = [ ] # for each group in groups
# for group in groupby #orwhatever:
#      for room in group:
#             groups.append(room)
lablefaces = HBLabelFaces(hb_objs=flatten(solveadj.adj_rooms), attribute=hb_face_attributes)  # -> label_text, base_pts, labels, wire_frame; plug-in component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
setstory = HBSetStory(rooms=solveadj.adj_rooms, story="1")  # -> out, rooms; plug-in component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
model = HBModel(rooms=flatten(setstory.rooms))  # -> out, model; plug-in component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
ghpython_script = GhPythonScript(x=model.model)  # -> out, a; inputs x: list
# ---------- ghpython_script: Python ----------
__author__ = "TREVOR"
__version__ = "2021.05.26"

import rhinoscriptsyntax as rs

import ladybug_rhino.fromgeometry as lbfg

for room in x:
    #for face in room.faces:
    fcs = [face.geometry for face in room.faces]
    print(fcs)
# ---------- end ghpython_script ----------
ghpython_script_2 = GhPythonScript(model=model.model)  # -> out, a, b, c, d, e, f, g
# ---------- ghpython_script_2: Python ----------
__author__ = "TREVOR"
__version__ = "2021.05.24"

import rhinoscriptsyntax as rs
from imp import reload
from ladybug_rhino import fromgeometry as fg
import ghpythonlib.components as ghc

import eQbug
import eQbug.fileBldr
from eQbug.fileBldr import eQspace, eQfloor
reload(eQbug)
reload(eQbug.fileBldr)

roomslst = []
flrget= []
flrlst = []

    
for room in _model.rooms:
    roomslst.append(eQspace(room))
    flrget.append(room)

for rm in flrget:
    floors =[ srfc for srfc in rm.faces if str(srfc.type)=='Floor']
    flrlst.append(floors)
burt = []
brp = []
for flr in flrlst:
    for f in flr:
        burt.append(f.geometry)
        
for b in burt:
    brp.append(fg.from_face3d(b))
    
ttlFloor = ghc.BrepJoin(brp).breps
levelFloorBrep = ttlFloor



def _get_verts(obj):
        brp_edges = ghc.DeconstructBrep(obj).edges
        brp_perim = ghc.JoinCurves(brp_edges, True)
        brp_verts = ghc.ControlPoints(brp_perim).points
        brpC =  ghc.CullDuplicates(brp_verts, 0.0).points
        verts = [(point.X,point.Y) for point in brpC]
        
        return verts

a = _get_verts(levelFloorBrep)


### NEED TO ADD STORY SORT


roomsToFloor=[]
for room in _model.rooms:
    roomsToFloor.append(room)
b = eQfloor(roomsToFloor)
c = b.floor_faces
d = b.floor_verts
e = b.floor_poly_strs
f = b.floor_space_strs
g = b.floor_zone_strs
print(b.rooms)
print('facesOfFloors',b.floor_faces)
print('check on floorfaces:::', b.floor_verts)
print(b.level)
print(b.room_inp_poly)
# ---------- end ghpython_script_2 ----------
panel_2 = Panel(ghpython_script_2.f)
panel_3 = Panel(ghpython_script_2.g)
panel_4 = Panel(ghpython_script_2.e)
ghpython_script_3 = GhPythonScript()  # -> out, a; inputs Rooms: list
# ---------- ghpython_script_3: Python ----------
__author__ = "TREVOR"
__version__ = "2021.04.08"



ghenv.Component.Message = "Working Progress\n_rooms->Floor"


import rhinoscriptsyntax as rs

try:  # import the core honeybee dependencies
    from honeybee.room import Room
    from honeybee.facetype import get_type_from_normal
    from honeybee.typing import clean_and_id_string
except ImportError as e:
    raise ImportError('\nFailed to import honeybee:\n\t{}'.format(e))

try:  # import the ladybug_rhino dependencies
    from ladybug_rhino.config import tolerance, angle_tolerance
    from ladybug_rhino.togeometry import to_polyface3d
    from ladybug_rhino.grasshopper import all_required_inputs, give_warning, \
        document_counter, longest_list
except ImportError as e:
    raise ImportError('\nFailed to import ladybug_rhino:\n\t{}'.format(e))

try:  # import the honeybee-energy extension
    from honeybee_energy.lib.programtypes import program_type_by_identifier, office_program
    from honeybee_energy.lib.constructionsets import construction_set_by_identifier
except ImportError as e:
    if len(_program_) != 0:
        raise ValueError('_program_ has been specified but honeybee-energy '
                         'has failed to import.\n{}'.format(e))
    elif len(_constr_set_) != 0:
        raise ValueError('_constr_set_ has been specified but honeybee-energy '
                         'has failed to import.\n{}'.format(e))
    elif len(conditioned_) != 0:
        raise ValueError('conditioned_ has been specified but honeybee-energy '
                         'has failed to import.\n{}'.format(e))

try:  # import the honeybee-radiance extension
    from honeybee_radiance.lib.modifiersets import modifier_set_by_identifier
except ImportError as e:
    if len(_mod_set_) != 0:
        raise ValueError('_mod_set_ has been specified but honeybee-radiance '
                         'has failed to import.\n{}'.format(e))







lst=[]
for i, room in enumerate( _Rooms):
    
    try:
        fcl = [face for face in enumerate(room.faces)]
        dd = fcl[-2]
        lst.append(dd)
    except  IndexError:
        raise IndexError('No faces found on room:"{obj.name}"')
    
    
    
    a = str(lst)
    print(a)
    print(type(a))
# ---------- end ghpython_script_3 ----------
ghpython_script_4 = GhPythonScript()  # -> out, a; inputs rooms: list
# ---------- ghpython_script_4: Python ----------
__author__ = "TREVOR"
__version__ = "2021.04.08"

import rhinoscriptsyntax as rs

ghenv.Component.Message = 'Working Enum\nRoomsToGet\nFLOORSRFCS'

try:  # import the core honeybee dependencies
    from honeybee.room import Room
    from honeybee.facetype import get_type_from_normal
    from honeybee.typing import clean_and_id_string
except ImportError as e:
    raise ImportError('\nFailed to import honeybee:\n\t{}'.format(e))

try:  # import the ladybug_rhino dependencies
    from ladybug_rhino.config import tolerance, angle_tolerance
    from ladybug_rhino.togeometry import to_polyface3d
    from ladybug_rhino.grasshopper import all_required_inputs, give_warning, \
        document_counter, longest_list
except ImportError as e:
    raise ImportError('\nFailed to import ladybug_rhino:\n\t{}'.format(e))

try:  # import the honeybee-energy extension
    from honeybee_energy.lib.programtypes import program_type_by_identifier, office_program
    from honeybee_energy.lib.constructionsets import construction_set_by_identifier
except ImportError as e:
    if len(_program_) != 0:
        raise ValueError('_program_ has been specified but honeybee-energy '
                         'has failed to import.\n{}'.format(e))
    elif len(_constr_set_) != 0:
        raise ValueError('_constr_set_ has been specified but honeybee-energy '
                         'has failed to import.\n{}'.format(e))
    elif len(conditioned_) != 0:
        raise ValueError('conditioned_ has been specified but honeybee-energy '
                         'has failed to import.\n{}'.format(e))

try:  # import the honeybee-radiance extension
    from honeybee_radiance.lib.modifiersets import modifier_set_by_identifier
except ImportError as e:
    if len(_mod_set_) != 0:
        raise ValueError('_mod_set_ has been specified but honeybee-radiance '
                         'has failed to import.\n{}'.format(e))
                         
                         
                         
                         



flrslst = []
vrtslst = []
for room in _rooms:
    floors  =[ srfc for srfc in room.faces if str(srfc.type) == 'Floor']
    flrslst.append(floors)

print(str(flrslst))
a = str(flrslst)
# ---------- end ghpython_script_4 ----------
panel_5 = Panel(ghpython_script_3.a)
panel_6 = Panel(ghpython_script_4.a)
ghpython_script_5 = GhPythonScript(rooms=setstory.rooms)  # -> out, a; inputs rooms: list
# ---------- ghpython_script_5: Python ----------
__author__ = "TREVOR"
__version__ = "2021.04.08"

import rhinoscriptsyntax as rs

ghenv.Component.Message = 'Working Enum\nRoomsToGet\nFLOORSRFCS'

try:  # import the core honeybee dependencies
    from honeybee.room import Room
    from honeybee.facetype import get_type_from_normal
    from honeybee.typing import clean_and_id_string
except ImportError as e:
    raise ImportError('\nFailed to import honeybee:\n\t{}'.format(e))

try:  # import the ladybug_rhino dependencies
    from ladybug_rhino.config import tolerance, angle_tolerance
    from ladybug_rhino.togeometry import to_polyface3d
    from ladybug_rhino.grasshopper import all_required_inputs, give_warning, \
        document_counter, longest_list
except ImportError as e:
    raise ImportError('\nFailed to import ladybug_rhino:\n\t{}'.format(e))

try:  # import the honeybee-energy extension
    from honeybee_energy.lib.programtypes import program_type_by_identifier, office_program
    from honeybee_energy.lib.constructionsets import construction_set_by_identifier
except ImportError as e:
    if len(_program_) != 0:
        raise ValueError('_program_ has been specified but honeybee-energy '
                         'has failed to import.\n{}'.format(e))
    elif len(_constr_set_) != 0:
        raise ValueError('_constr_set_ has been specified but honeybee-energy '
                         'has failed to import.\n{}'.format(e))
    elif len(conditioned_) != 0:
        raise ValueError('conditioned_ has been specified but honeybee-energy '
                         'has failed to import.\n{}'.format(e))

try:  # import the honeybee-radiance extension
    from honeybee_radiance.lib.modifiersets import modifier_set_by_identifier
except ImportError as e:
    if len(_mod_set_) != 0:
        raise ValueError('_mod_set_ has been specified but honeybee-radiance '
                         'has failed to import.\n{}'.format(e))

import ghpythonlib.components as ghc
import ladybug_geometry.bounding
from ladybug_geometry.bounding import bounding_box, bounding_box_extents
from ladybug_geometry.geometry3d.polyface import Polyface3D
from ladybug_geometry.geometry2d.polyline import Polyline2D as p2d
from ladybug_rhino import fromgeometry as fg




flrslst = []
vrtslst = []
for room in _rooms:
    floors  =[ srfc for srfc in room.faces if str(srfc.type) == 'Floor']
    flrslst.append(floors)
    for face in flrslst:
        for f in face:
            vt = f.vertices
            for v in vt:
                vs = (v.x, v.y)
                vrtslst.append(vs)

#print(str(flrslst))



burt = []
brp = []
for flr in flrslst:
    for f in flr:
        burt.append(f.geometry)
        
for b in burt:
    brp.append(fg.from_face3d(b))
    
ttlFloor = ghc.BrepJoin(brp).breps
balls = ttlFloor

def _get_verts(obj):
        brp_edges = ghc.DeconstructBrep(obj).edges
        brp_perim = ghc.JoinCurves(brp_edges, True)
        brp_verts = ghc.ControlPoints(brp_perim).points
        brpC =  ghc.CullDuplicates(brp_verts, 0.0).points
        verts = [(point.X,point.Y) for point in brpC]
        
        return verts

test = _get_verts(ttlFloor)
print(test)

a = test



#https://www.ladybug.tools/ladybug-rhino/docs/ladybug_rhino.fromgeometry.html
# ---------- end ghpython_script_5 ----------
panel_7 = Panel(ghpython_script_5.a)
ghpython_script_6 = GhPythonScript(rms=setstory.rooms)  # -> out, a, b, c, d, e
# ---------- ghpython_script_6: Python ----------
__author__ = "TREVOR"
__version__ = "2021.04.07"

import rhinoscriptsyntax as rs
from imp import reload

import eQbug
import eQbug.fileBldr
from eQbug.fileBldr import eQspace
reload(eQbug)
reload(eQbug.fileBldr)
try:  # import the core ladybug_rhino dependencies
    from ladybug_rhino.config import tolerance
    from ladybug_rhino.grasshopper import all_required_inputs
except ImportError as e:
    raise ImportError('\nFailed to import ladybug_rhino:\n\t{}'.format(e))

try:
    faces= [face for face in _rms.faces]
    a = faces[-2]
except IndexError:
    raise IndexError('No faces found on room:"{rms.name}')

vrtslst = [a.vertices]

#print(vrtslst)

tstSpc = eQspace(_rms)

#print(tstSpc.spc_vrts)

print(tstSpc.spcPlystr)

print(tstSpc.lvl)

b = tstSpc.spcPlystr

c = tstSpc.spcSpace

d = tstSpc.spcZone

e = tstSpc.floorSrfc
# ---------- end ghpython_script_6 ----------
panel_8 = Panel(ghpython_script_6.e)
poly = Panel(ghpython_script_6.b)
space = Panel(ghpython_script_6.c)
zone = Panel(ghpython_script_6.d)
